# Grasshopper definition IsolateRoofSurfaces.gh (Grasshopper 1.0.7)
# plug-ins: RhinoCityJSON

# ---- group: Adjust to file!
toggle = BooleanToggle(False)
path = FilePath()
pt = Point(Point(0, 0, 0))
panel = Panel("50")
panel_2 = Panel("2")

# ----
rsettings = ReaderSettings(Translate=toggle, ModelOrigin=pt, TrueNorth=panel, LoD=panel_2)
reader = RCJReader(Path=path, Activate=Toggle(True), Settings=rsettings)  # -> Geometry, SurfaceInfoKeys, SurfaceInfoVales, ObjectInfoKeys, ObjectInfoValues

# ---- group: Based on the keys the surface type can be isolated
panel_3 = Panel(reader.SurfaceInfoKeys)
item = ListItem(List=reader.SurfaceInfoVales, Index="4", Wrap=True)  # -> flatten(Item)

# ----
mindex = MemberIndex(Set=item, Member="RoofSurface")  # -> Index, Count
item_2 = ListItem(List=reader.Geometry, Index=mindex.Index, Wrap=True)
preview = CustomPreview(
    Geometry=item_2,
    Material={diffuse=RGB(221, 160, 221), emission=RGB(66, 48, 66), shine=0.5, specular=RGB(255, 255, 255), transparency=0})
