# Grasshopper definition ReadAndBakeFile.gh (Grasshopper 1.0.7)
# plug-ins: RhinoCityJSON

# ---- group: Adjust to file!
toggle = BooleanToggle(False)
path = FilePath()
pt = Point(Point(0, 0, 0))
panel = Panel("50")
panel_2 = Panel("2")

# ----
rsettings = ReaderSettings(Translate=toggle, ModelOrigin=pt, TrueNorth=panel, LoD=panel_2)
reader = RCJReader(Path=path, Activate=Toggle(True), Settings=rsettings)  # -> Geometry, SurfaceInfoKeys, SurfaceInfoVales, ObjectInfoKeys, ObjectInfoValues
idivide = InformationDivider(
    SurfaceInfoKeys=reader.SurfaceInfoKeys,
    SurfaceInfoVales=reader.SurfaceInfoVales,
    ObjectInfoKeys=reader.ObjectInfoKeys,
    ObjectInfoValues=reader.ObjectInfoValues)  # -> MergedSurfaceInfoKeys, MergedSurfaceInfoVales
bakery = RCJBakery(
    Geometry=reader.Geometry,
    SurfaceInfoKeys=idivide.MergedSurfaceInfoKeys,
    SurfaceInfo=idivide.MergedSurfaceInfoVales,
    Activate=Button())
